# Grasshopper definition 3Dplant_final.gh (Grasshopper 0.9.76)
# plug-ins: Firefly.Core

ports_available = COMPortsAvailable()
open_port = OpenClosePort(OpenClosePort=Toggle(True), PortNumber="17", BaudRate=115200)
panel = Panel(ports_available)
panel_2 = Panel(open_port)
timer = Timer(TimerInterval=100, Target=uno_read)
val = Slider(47, range=0..50)
z_value = Slider(131, range=0..180)
uno_read = UnoRead(StartReadingValues=Toggle(True), PortNumber="17")  # -> AnalogPin0, AnalogPin1, AnalogPin2, AnalogPin3, AnalogPin4, AnalogPin5, DigitalPin2, DigitalPin4, DigitalPin7, StatusMessage
multiplication = Multiplication(A=uno_read.AnalogPin0, B=0.8)
z_division = Slider(6, range=0..10)
panel_3 = Panel(multiplication)
division = Division(A=uno_read.AnalogPin0, B="20")
pt = ConstructPoint(XCoordinate=0, YCoordinate=0, ZCoordinate=0)
pt_2 = ConstructPoint(XCoordinate=0, YCoordinate=0, ZCoordinate=z_value)
panel_4 = Panel(uno_read.AnalogPin2)
panel_5 = Panel(uno_read.AnalogPin1)
panel_6 = Panel(uno_read.AnalogPin0)
panel_7 = Panel(division)
ln = Line(StartPoint=pt, EndPoint=pt_2)
panel_8 = Panel(uno_read.AnalogPin4)
divide = DivideCurve(Curve=ln, Count=z_division, Kinks=False)  # -> Points, Tangents, Parameters
division_2 = Division(A=panel_6, B="8")
division_3 = Division(A=panel_5, B="30")
val_2 = Slider(40, range=0..50)
base = Slider(47, range=20..100)
val_3 = Slider(33, range=0..50)
division_4 = Division(A=panel_4, B="20")
val_4 = Slider(36, range=0..50)
top = Slider(33, range=0..50)
panel_9 = Panel(division_2)
panel_10 = Panel(division_3)
division_5 = Division(A=panel_8, B="80")
panel_11 = Panel(division_4)
division_6 = Division(A=panel_8, B="10")
panel_12 = Panel(division_6)
panel_13 = Panel(division_5)
num_segments = Slider(9, range=3..15)
panel_14 = Panel([base, panel_9, panel_7, panel_10, panel_11])
polygon = Polygon(Plane=divide.Points, Radius=panel_14, Segments=panel_13, FilletRadius=0)  # -> Polygon, Length
loft = Loft(Curves=polygon.Polygon, Options={Adjust=False, Closed=False, LoftEnds=0, LoftSimp=0, LoftType=0, Rebuild=10, Refit=0.01})
cap = CapHoles(Brep=loft)
